# Grasshopper definition eiffel1.gh (Grasshopper 1.0.4)

crv = Curve(<curve referenced from the Rhino model>)
crv_2 = Curve(<curve referenced from the Rhino model>)
divide = DivideCurve(Curve=crv, Count=Slider(15, range=0..100), Kinks=False)  # -> Points, Tangents, Parameters
divide_2 = DivideCurve(Curve=crv_2, Count=Slider(15, range=0..100), Kinks=False)  # -> Points, Tangents, Parameters
shift = ShiftList(List=divide_2.Points, Shift=1, Wrap=True)
ln = Line(StartPoint=divide.Points, EndPoint=divide_2.Points)
shift_2 = ShiftList(List=divide.Points, Shift=1, Wrap=True)
ln_2 = Line(StartPoint=divide.Points, EndPoint=shift)
ln_3 = Line(StartPoint=shift_2, EndPoint=divide_2.Points)
