# Grasshopper definition eiffel2.gh (Grasshopper 0.9.76)
# plug-ins: Heteroptera

pi = Pi(Factor=Slider(0.5, range=0..1))
point = Point(Point(0, 0, 0))
pi_2 = Pi(Factor=Slider(1.5, range=0..10))
pi_3 = Pi(Factor=1)
number_slider = Slider(0.45, range=0..1)
number_slider_2 = Slider(0.25, range=0..1)
curve = Curve(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)
rotate = Rotate(Geometry=curve, Angle=pi_2, Plane=point)  # -> Geometry, Transform
rotate_2 = Rotate(Geometry=curve, Angle=pi_3, Plane=point)  # -> Geometry, Transform
rotate_3 = Rotate(Geometry=curve, Angle=1.570796327, Plane=point)  # -> Geometry, Transform
number_slider_3 = Slider(0.05, range=0..0.1)
cluster = Cluster_2()
merge = Merge(Data1=curve, Data2=rotate_3.Geometry, Data3=rotate_2.Geometry, Data4=rotate.Geometry)
number_slider_4 = Slider(0.4, range=0..1)
cluster_2 = Cluster_5(d1=number_slider_2, d2=number_slider, curve=rotate.Geometry)
cluster_3 = Cluster_5(d1=number_slider_2, d2=number_slider, curve=rotate_2.Geometry)
number_slider_5 = Slider(1, range=0..1)
cluster_4 = Cluster_2(curve=merge, parameter=number_slider_5)
curve_2 = Curve(cluster_2)
curve_3 = Curve(cluster_3)
cluster_5 = Cluster_2(curve=merge, parameter=number_slider_5)
cluster_6 = Cluster_3(parameter=number_slider_4, curve=merge, B=number_slider_3)
cluster_7 = Cluster_3(parameter=Slider(0.6, range=0..1), curve=merge, B=number_slider_3)
number_slider_6 = Slider(0.1, range=0..0.1)
number_slider_7 = Slider(0.21, range=0..1)
number_slider_8 = Slider(12, range=0..100)
number_slider_9 = Slider(32, range=0..100)
cluster_8 = Cluster_2(curve=merge, parameter=number_slider_5)
cluster_9 = Cluster(
    curve=rotate_2.Geometry,
    curve2=rotate_3.Geometry,
    A=number_slider_7,
    B=number_slider_9,
    v_count=number_slider_8,
    radius=number_slider_6)  # -> inner_curves, pipe_2
cluster_10 = Cluster(
    curve=curve,
    curve2=rotate_3.Geometry,
    A=number_slider_7,
    B=number_slider_9,
    v_count=number_slider_8,
    radius=number_slider_6)  # -> inner_curves, pipe_2
cluster_11 = Cluster(
    curve=rotate_2.Geometry,
    curve2=rotate.Geometry,
    A=number_slider_7,
    B=number_slider_9,
    v_count=number_slider_8,
    radius=number_slider_6)  # -> inner_curves, pipe_2
cluster_12 = Cluster(
    curve=rotate.Geometry,
    curve2=curve,
    A=number_slider_7,
    B=number_slider_9,
    v_count=number_slider_8,
    radius=number_slider_6)  # -> inner_curves, pipe_2
cluster_13 = Cluster_9(factor=Slider(1.2, range=0..10), geometry=cluster_5, count=Slider(15, range=0..100), factor_2=Slider(2, range=0..10))
center = Center(Geometry=cluster_8)  # -> Center, Dimension
scale = Scale(Geometry=cluster_8, Center=center.Center, Factor=Slider(1.1, range=0..10))  # -> Geometry, Transform
unit_z = UnitZ(Factor=Slider(0.25, range=0..1))
merge_2 = Merge(Data1=cluster_12.pipe_2, Data2=cluster_11.pipe_2, Data3=cluster_9.pipe_2, Data4=cluster_10.pipe_2)
entwine = Entwine(
    Branch00=cluster_12.inner_curves,
    Branch01=cluster_11.inner_curves,
    Branch02=cluster_9.inner_curves,
    Branch03=cluster_10.inner_curves,
    FlattenInputs=True)
polyline = PolyLine(Closed=False)
move = Move(Geometry=scale.Geometry, Motion=unit_z)  # -> Geometry, Transform
cluster_14 = Cluster_4(
    curve=merge,
    parameter=number_slider_4,
    parameter_2=Slider(0.35, range=0..1),
    list=entwine,
    parameter_3=Slider(0.11, range=0..1))
cluster_15 = Cluster_6(
    parameter_2=Slider(0.5, range=0..1),
    parameter_3=Slider(0.7, range=0..1),
    curve_2=cluster_14,
    d1=curve_3,
    d2=curve_2,
    curve=merge,
    parameter=number_slider)
panel = Panel("""0
22
10
0
1
-1
0
-4
0
-6
0
5
0
-6
0
-12
0
-5
1
-2
0
7
0
-10""")
panel_2 = Panel("""0
0
18
12
12
1
7
3
3
0
6
5
5
0
6
0
21
0
35
0
42
0
5
0""")
number_slider_10 = Slider(12, range=0..100)
curve_4 = Curve(<curve referenced from the Rhino model>)
cluster_16 = Cluster_7(integer=panel, integer_3=panel_2)  # -> polyline_2, curve
curve_5 = Curve(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)
explode = Explode(Curve=curve_5, Recursive=True)  # -> Segments, Vertices
end_points = EndPoints(Curve=explode.Segments)  # -> Start, End
list_item = ListItem(List=end_points.End, Index=Slider(-1, range=-1..0), Wrap=True)
merge_3 = Merge(Data1=end_points.Start, Data2=list_item)
deconstruct_vector = DeconstructVector(Vector=merge_3)  # -> XComponent, YComponent, ZComponent
round = Round(Number=deconstruct_vector.XComponent)  # -> Nearest, Floor, Ceiling
round_2 = Round(Number=deconstruct_vector.YComponent)  # -> Nearest, Floor, Ceiling
rebuild_curve = RebuildCurve(Curve=curve_5, Count=number_slider_10, Tangents=False)
panel_3 = Panel("""0
110
50
50
50
50
50
40
30""")
rebuild_curve_2 = RebuildCurve(Curve=curve_4, Count=number_slider_10, Tangents=False)
panel_4 = Panel("""0
200
100
120
150
190
260
440
690""")
cluster_17 = Cluster_7(integer=panel_3, integer_3=panel_4)  # -> polyline_2, curve
curve_6 = Curve(cluster_17.polyline_2)
curve_7 = Curve(rebuild_curve)
number_slider_11 = Slider(90, range=0..100)
curve_8 = Curve(rebuild_curve_2)
number_slider_12 = Slider(180, range=0..1000)
number_slider_13 = Slider(270, range=0..1000)
curve_9 = Curve(cluster_17.curve)
point_2 = Point(Point(487.9169123, -123.6715614, 0))
xz_plane = XZPlane(Origin=point_2)
rotate_4 = Rotate(Geometry=curve_7, Angle=degrees(number_slider_13), Plane=xz_plane)  # -> Geometry, Transform
rotate_5 = Rotate(Geometry=curve_7, Angle=degrees(number_slider_12), Plane=xz_plane)  # -> Geometry, Transform
rotate_6 = Rotate(Geometry=curve_7, Angle=degrees(number_slider_11), Plane=xz_plane)  # -> Geometry, Transform
rotate_7 = Rotate(Geometry=curve_8, Angle=degrees(number_slider_13), Plane=xz_plane)  # -> Geometry, Transform
rotate_8 = Rotate(Geometry=curve_8, Angle=degrees(number_slider_12), Plane=xz_plane)  # -> Geometry, Transform
rotate_9 = Rotate(Geometry=curve_8, Angle=degrees(number_slider_11), Plane=xz_plane)  # -> Geometry, Transform
merge_4 = Merge(Data1=rotate_4.Geometry, Data2=rotate_6.Geometry)
merge_5 = Merge(Data1=rebuild_curve_2, Data2=rotate_5.Geometry)
merge_6 = Merge(Data1=rotate_7.Geometry, Data2=rotate_8.Geometry, Data3=rotate_9.Geometry, Data4=rebuild_curve_2)
merge_7 = Merge(Data1=rotate_7.Geometry, Data2=rotate_9.Geometry)
merge_8 = Merge(Data1=rebuild_curve_2, Data2=rotate_8.Geometry)
loft = Loft(Curves=merge_4, Options={Adjust=False, Closed=False, LoftEnds=0, LoftSimp=0, LoftType=0, Rebuild=10, Refit=0.01})
loft_2 = Loft(Curves=merge_5, Options={Adjust=False, Closed=False, LoftEnds=0, LoftSimp=0, LoftType=0, Rebuild=10, Refit=0.01})
shift_list = ShiftList(List=merge_6, Shift=1, Wrap=True)
loft_3 = Loft(Curves=merge_7, Options={Adjust=False, Closed=False, LoftEnds=0, LoftSimp=0, LoftType=0, Rebuild=10, Refit=0.01})
loft_4 = Loft(Curves=merge_8, Options={Adjust=False, Closed=False, LoftEnds=0, LoftSimp=0, LoftType=0, Rebuild=10, Refit=0.01})
entwine_2 = Entwine(Branch00=merge_6, Branch01=shift_list, FlattenInputs=True)
loft_5 = Loft(Curves=entwine_2, Options={Adjust=False, Closed=False, LoftEnds=0, LoftSimp=0, LoftType=0, Rebuild=10, Refit=0.01})
divide_surface = DivideSurface(Surface=loft_5, UCount="30", VCount="30")  # -> flatten(Points), Normals, Parameters
sphere = Sphere(Base=divide_surface.Points, Radius=Slider(5, range=0..10))  # disabled

# ==== cluster Cluster
curve = ClusterInput()
curve2 = ClusterInput()
merge = Merge(Data1=curve, Data2=curve2)
loft = Loft(Curves=merge, Options={Adjust=False, Closed=False, LoftEnds=0, LoftSimp=0, LoftType=0, Rebuild=10, Refit=0.01})
A = ClusterInput()
B = ClusterInput()
v_count = ClusterInput()
legs = Legs(A=A, u_count=B, surface=loft, v_count=v_count)  # -> i, i_2
truss = Truss(curve_2=curve2, count=v_count, curve=legs.i_2)  # -> diagonal1, diagonal2, cross
merge_2 = Merge(Data1=legs.i, Data2=legs.i_2)
truss_2 = Truss(curve_2=curve, count=v_count, curve=legs.i)  # -> diagonal1, diagonal2, cross
inner_curves = ClusterOutput(merge_2)
radius = ClusterInput()
merge_3 = Merge(
    Data1=truss_2.diagonal1,
    Data2=truss_2.diagonal2,
    Data3=truss_2.cross,
    Data4=truss.diagonal1,
    Data5=truss.diagonal2,
    Data6=truss.cross,
    Data7=legs.i,
    Data8=legs.i_2)
pipe = Pipe(Curve=merge_3, Radius=radius, Caps=0)
pipe_2 = ClusterOutput(pipe)

# ==== cluster Cluster_3
parameter = ClusterInput()
B = ClusterInput()
addition = Addition(A=parameter, B=B)
curve = ClusterInput()
cluster = Cluster_2(curve=curve, parameter=parameter)
cluster_2 = Cluster_2(curve=curve, parameter=addition)
explode = Explode(Curve=cluster_2, Recursive=True)  # -> Segments, Vertices
explode_2 = Explode(Curve=cluster, Recursive=True)  # -> Segments, Vertices
merge = Merge(Data1=cluster, Data2=cluster_2)
loft = Loft(Curves=merge, Options={Adjust=False, Closed=False, LoftEnds=0, LoftSimp=0, LoftType=0, Rebuild=10, Refit=0.01})
end_points = EndPoints(Curve=explode.Segments)  # -> Start, End
end_points_2 = EndPoints(Curve=explode_2.Segments)  # -> Start, End
line = Line(StartPoint=end_points.Start, EndPoint=end_points_2.Start)
loft_2 = ClusterOutput(loft)
shift_list = ShiftList(List=line, Shift=1, Wrap=True)
entwine = Entwine(Branch00=line, Branch01=shift_list, FlattenInputs=True)
loft_3 = Loft(Curves=entwine, Options={Adjust=False, Closed=False, LoftEnds=0, LoftSimp=0, LoftType=0, Rebuild=10, Refit=0.01})

# ==== cluster Cluster_4
curve = ClusterInput()
parameter = ClusterInput()
parameter_2 = ClusterInput()
cluster = Cluster_2(curve=curve, parameter=parameter)
cluster_2 = Cluster_2(curve=curve, parameter=parameter_2)
flip = Flip(Surface=cluster_2)  # -> Surface, Result
explode = Explode(Curve=flip.Surface, Recursive=True)  # -> Segments, Vertices
end_points = EndPoints(Curve=curve)  # -> Start, End
evaluate_curve = EvaluateCurve(Curve=reparameterize(explode.Segments), Parameter=Slider(0.5, range=0..1))  # -> Point, Tangent, Angle
shift_list = ShiftList(List=evaluate_curve.Point, Shift=Slider(1, range=0..10), Wrap=True)
shift_list_2 = ShiftList(List=end_points.Start, Shift=1, Wrap=True)
list = ClusterInput()
list_item = ListItem(List=list, Index=0, Wrap=True)  # -> flatten(Item)
list_item_2 = ListItem(List=list, Index=Slider(1, range=0..1), Wrap=True)  # -> flatten(Item)
parameter_3 = ClusterInput()
evaluate_curve_2 = EvaluateCurve(Curve=reparameterize(list_item), Parameter=parameter_3)  # -> Point, Tangent, Angle
evaluate_curve_3 = EvaluateCurve(Curve=reparameterize(list_item_2), Parameter=parameter_3)  # -> Point, Tangent, Angle
entwine = Entwine(Branch00=evaluate_curve_2.Point, Branch01=shift_list, Branch02=evaluate_curve_3.Point, FlattenInputs=True)
flip_matrix = FlipMatrix(Data=entwine)
end_points_2 = EndPoints(Curve=list_item)  # -> Start, End
interpolate = Interpolate(Vertices=flip_matrix, Degree=3, Periodic=False, KnotStyle=1)  # -> Curve, Length, Domain
end_points_3 = EndPoints(Curve=list_item_2)  # -> Start, End
list_item_3 = ListItem(List=flatten(interpolate.Curve), Index=Slider(1, range=0..1), Wrap=True)
i = ClusterOutput(list_item_3)

# ==== cluster Cluster_5
d1 = ClusterInput()
d2 = ClusterInput()
merge = Merge(Data1=d1, Data2=d2)
curve = ClusterInput()
shatter = Shatter(Curve=reparameterize(curve), Parameters=merge)
list_item = ListItem(List=shatter, Index=Slider(1, range=0..1), Wrap=True)
i = ClusterOutput(list_item)

# ==== cluster Cluster_6
curve = ClusterInput()
parameter = ClusterInput()
d1 = ClusterInput()
d2 = ClusterInput()
curve_2 = ClusterInput()

cluster = Cluster_2(curve=curve, parameter=parameter)
explode = Explode(Curve=cluster, Recursive=True)  # -> Segments, Vertices
list_item = ListItem(List=explode.Segments, Index=Slider(2, range=0..10), Wrap=True)
merge = Merge(Data1=d1, Data2=d2, Data3=list_item)
join_curves = JoinCurves(Curves=merge, Preserve=False)
number_slider = Slider(25, range=0..100)
rebuild_curve = RebuildCurve(Curve=join_curves, Count=Slider(100, range=0..100), Tangents=False)
divide_curve = DivideCurve(Curve=rebuild_curve, Count=number_slider, Kinks=False)  # -> Points, Tangents, Parameters
divide_curve_2 = DivideCurve(Curve=curve_2, Count=number_slider, Kinks=False)  # -> Points, Tangents, Parameters
line = Line(StartPoint=divide_curve_2.Points, EndPoint=divide_curve.Points)

parameter_2 = ClusterInput()
parameter_3 = ClusterInput()

boolean_toggle = BooleanToggle(False)
evaluate_curve = EvaluateCurve(Curve=reparameterize(line), Parameter=parameter_2)  # -> Point, Tangent, Angle
evaluate_curve_2 = EvaluateCurve(Curve=line, Parameter=parameter_3)  # -> Point, Tangent, Angle
shift_list = ShiftList(List=evaluate_curve_2.Point, Shift=1, Wrap=boolean_toggle)
shift_list_2 = ShiftList(List=evaluate_curve.Point, Shift=1, Wrap=boolean_toggle)
shortest_list = ShortestList(ListListA=evaluate_curve_2.Point, ListListB=shift_list, TrimMode=2)  # -> ListListA, ListListB
shortest_list_2 = ShortestList(ListListA=evaluate_curve.Point, ListListB=shift_list_2, TrimMode=2)  # -> ListListA, ListListB
line_2 = Line(StartPoint=shortest_list.ListListA, EndPoint=shortest_list.ListListB)
evaluate_curve_3 = EvaluateCurve(Curve=reparameterize(line_2), Parameter=Slider(0.5, range=0..1))  # -> Point, Tangent, Angle
entwine = Entwine(
    Branch00=shortest_list_2.ListListA,
    Branch01=evaluate_curve_3.Point,
    Branch02=shortest_list_2.ListListB,
    FlattenInputs=True)
merge_2 = Merge(Data1=shortest_list_2.ListListA, Data2=evaluate_curve_3.Point, Data3=shortest_list_2.ListListB)
flip_matrix = FlipMatrix(Data=entwine)
interpolate = Interpolate(Vertices=flip_matrix, Degree=3, Periodic=False, KnotStyle=1)  # -> flatten(Curve), Length, Domain

curve_3 = ClusterOutput(interpolate.Curve)

# ==== cluster Cluster_7
integer = ClusterInput()
integer_2 = Integer(integer)
integer_3 = ClusterInput()
integer_4 = Integer(integer_3)
point = Point(Point(0, 0, 0))
python_script = PythonScript(x=integer_2)  # -> out, a; inputs x: list
# ---------- python_script: Python ----------
total = 0
a = []
for e in x:
    total += e
    a.append(total)
# ---------- end python_script ----------
python_script_2 = PythonScript(x=integer_4)  # -> out, a; inputs x: list; same code as python_script
construct_point = ConstructPoint(XCoordinate=python_script.a, YCoordinate=python_script_2.a, ZCoordinate=0)
move = Move(Geometry=point, Motion=construct_point)  # -> Geometry, Transform
interpolate = Interpolate(Vertices=move.Geometry, Degree=3, Periodic=False, KnotStyle=1)  # -> Curve, Length, Domain
polyline = PolyLine(Vertices=move.Geometry, Closed=False)
curve = ClusterOutput(interpolate.Curve)
polyline_2 = ClusterOutput(polyline)

# ==== cluster Cluster_9
geometry = ClusterInput()
center = Center(Geometry=geometry)  # -> Center, Dimension
factor = ClusterInput()
scale = Scale(Geometry=geometry, Center=center.Center, Factor=factor)  # -> Geometry, Transform
factor_2 = ClusterInput()
cluster = Cluster_8(factor=factor_2, geometry=geometry)  # -> loft_2, line_2
cluster_2 = Cluster_8(factor=factor_2, geometry=scale.Geometry)  # -> loft_2, line_2
count = ClusterInput()
division = Division(A=Slider(1, range=0..1), B=count)
shift_list = ShiftList(List=cluster_2.line_2, Shift=1, Wrap=True)
series = Series(Start=0, Step=division, Count=count)
shift_list_2 = ShiftList(List=cluster.line_2, Shift=1, Wrap=True)
tween_curve = TweenCurve(CurveA=cluster_2.line_2, CurveB=shift_list, Factor=graft(series), BlendType=0)
tween_curve_2 = TweenCurve(CurveA=cluster.line_2, CurveB=shift_list_2, Factor=graft(series), BlendType=0)
entwine = Entwine(Branch00=tween_curve, Branch01=tween_curve_2, FlattenInputs=True)
flip_matrix = FlipMatrix(Data=entwine)
loft = Loft(Curves=flip_matrix, Options={Adjust=False, Closed=False, LoftEnds=0, LoftSimp=0, LoftType=0, Rebuild=10, Refit=0.01})
loft_2 = ClusterOutput(loft)

# ==== cluster Legs
surface = ClusterInput()
v_count = ClusterInput()
A = ClusterInput()
u_count = ClusterInput()
divide_surface = DivideSurface(Surface=surface, UCount=u_count, VCount=v_count)  # -> simplify(Points), Normals, Parameters
multiplication = Multiplication(A=A, B=u_count)
interpolate = Interpolate(Vertices=divide_surface.Points, Degree=3, Periodic=False, KnotStyle=1)  # -> flatten(Curve), Length, Domain
round = Round(Number=multiplication)  # -> Nearest, Floor, Ceiling
negative = Negative(Value=round.Nearest)
list_item = ListItem(List=interpolate.Curve, Index=round.Nearest, Wrap=True)
i = ClusterOutput(list_item)
list_item_2 = ListItem(List=interpolate.Curve, Index=negative, Wrap=True)
i_2 = ClusterOutput(list_item_2)

# ==== cluster Truss
curve = ClusterInput()
curve_2 = ClusterInput()
count = ClusterInput()
divide_curve = DivideCurve(Curve=curve, Count=count, Kinks=False)  # -> Points, Tangents, Parameters
divide_curve_2 = DivideCurve(Curve=curve_2, Count=count, Kinks=False)  # -> Points, Tangents, Parameters
line = Line(StartPoint=divide_curve_2.Points, EndPoint=divide_curve.Points)
shift_list = ShiftList(List=divide_curve.Points, Shift=1, Wrap=Toggle(False))
shift_list_2 = ShiftList(List=divide_curve_2.Points, Shift=1, Wrap=Toggle(False))
shortest_list = ShortestList(ListListA=shift_list_2, ListListB=divide_curve.Points, TrimMode=2)  # -> ListListA, ListListB
shortest_list_2 = ShortestList(ListListA=divide_curve_2.Points, ListListB=shift_list, TrimMode=2)  # -> ListListA, ListListB
cross = ClusterOutput(line)
line_2 = Line(StartPoint=shortest_list.ListListA, EndPoint=shortest_list.ListListB)
line_3 = Line(StartPoint=shortest_list_2.ListListA, EndPoint=shortest_list_2.ListListB)
diagonal1 = ClusterOutput(line_2)
diagonal2 = ClusterOutput(line_3)

# ==== cluster Cluster_2
curve = ClusterInput()
parameter = ClusterInput()
evaluate_curve = EvaluateCurve(Curve=reparameterize(curve), Parameter=parameter)  # -> Point, Tangent, Angle
list_item = ListItem(List=evaluate_curve.Point, Index=0, Wrap=True)
merge = Merge(Data1=evaluate_curve.Point, Data2=list_item)
polyline = PolyLine(Vertices=merge, Closed=False)
polyline_2 = ClusterOutput(polyline)

# ==== cluster Cluster_8
factor = ClusterInput()
unit_z = UnitZ(Factor=factor)
geometry = ClusterInput()
move = Move(Geometry=geometry, Motion=unit_z)  # -> Geometry, Transform
explode = Explode(Curve=geometry, Recursive=True)  # -> Segments, Vertices
explode_2 = Explode(Curve=move.Geometry, Recursive=True)  # -> Segments, Vertices
merge = Merge(Data1=geometry, Data2=move.Geometry)
loft = Loft(Curves=merge, Options={Adjust=False, Closed=False, LoftEnds=0, LoftSimp=0, LoftType=0, Rebuild=10, Refit=0.01})
end_points = EndPoints(Curve=explode.Segments)  # -> Start, End
end_points_2 = EndPoints(Curve=explode_2.Segments)  # -> Start, End
loft_2 = ClusterOutput(loft)
line = Line(StartPoint=end_points.Start, EndPoint=end_points_2.Start)
line_2 = ClusterOutput(line)
