# Grasshopper definition eiffel3.gh (Grasshopper 1.0.4)

number_slider = Slider(5, range=0..10)
crv = Curve(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)
pt = Point(Point(0, 0, 0))
divide = DivideCurve(Curve=crv, Count=Slider(15, range=0..100), Kinks=False)  # -> Points, Tangents, Parameters
vec = VectorXYZ(XComponent=Slider(1, range=0..1), YComponent=Slider(1, range=0..1), ZComponent=Slider(6, range=0..10))  # -> Vector, Length
shift = ShiftList(List=divide.Points, Shift=1, Wrap=Toggle(False))
short = ShortestList(ListA=divide.Points, ListB=shift, TrimMode=2)  # -> ListA, ListB
ln = Line(StartPoint=short.ListA, EndPoint=short.ListB)
devec = DeconstructVector(Vector=ln)  # -> XComponent, YComponent, ZComponent
cluster = Cluster(P_2=pt, X=number_slider, P=vec.Vector)
cluster_2 = Cluster(P_2=divide.Points, X=number_slider, P=ln)

# ==== cluster Cluster
P = ClusterInput()
P_2 = ClusterInput()
X = ClusterInput()
rectangle = Rectangle(Plane=P_2, XSize=X, YSize=X, Radius=0)  # -> Rectangle, Length
rectangle_2 = Rectangle(Plane=P, XSize=X, YSize=X, Radius=0)  # -> Rectangle, Length
number_slider = Slider(4, range=0..10)
explode = Explode(Curve=rectangle.Rectangle, Recursive=True)  # -> Segments, Vertices
explode_2 = Explode(Curve=rectangle_2.Rectangle, Recursive=True)  # -> Segments, Vertices
split = SplitList(List=explode.Vertices, Index=number_slider)  # -> ListA, ListB
split_2 = SplitList(List=explode_2.Vertices, Index=number_slider)  # -> ListA, ListB
shift = ShiftList(List=split.ListA, Shift=1, Wrap=True)
shift_2 = ShiftList(List=split_2.ListA, Shift=1, Wrap=True)
ln = Line(StartPoint=split.ListA, EndPoint=split_2.ListA)
ln_2 = Line(StartPoint=shift, EndPoint=explode_2.Vertices)
ln_3 = Line(StartPoint=explode.Vertices, EndPoint=shift_2)
merge = Merge(Data1=ln, Data2=ln_2, Data3=ln_3, Data4=explode_2.Segments, Data5=explode.Segments)  # -> flatten(Result)
R = ClusterOutput(merge)
