# Grasshopper definition eiffel2.gh (Grasshopper 1.0.4)

crv = Curve(<curve referenced from the Rhino model>)
number_slider = Slider(5, range=0..10)
divide = DivideCurve(Curve=crv, Count=Slider(12, range=0..100), Kinks=False)  # -> Points, Tangents, Parameters
rectangle = Rectangle(Plane=divide.Points, XSize=number_slider, YSize=number_slider, Radius=0)  # -> Rectangle, Length
explode = Explode(Curve=rectangle.Rectangle, Recursive=True)  # -> simplify(Segments), Vertices
end = EndPoints(Curve=explode.Segments)  # -> Start, End
flip = FlipMatrix(Data=end.Start)
shift = ShiftList(List=end.Start, Shift=1, Wrap=True)  # -> simplify(List)
pt = Point(flatten(flip))
pt_2 = Point(flatten(shift))
ln = Line(StartPoint=pt, EndPoint=pt_2)
